# Grasshopper definition urban_planing_parametric_model.gh (Grasshopper 1.0.7)

genes = GenePool(Decimals=2, Maximum=0.8, Minimum=0.2, Value=[0.49, 0.8, 0.25, 0.56, 0.2, 0.8, 0.5, 0.5])
genes_2 = GenePool(Decimals=0, Maximum=1, Minimum=0, Value=[0, 1, 0, 1, 0, 0.5])
genes_3 = GenePool(Decimals=0, Maximum=1, Minimum=0, Value=[0, 1, 1, 0, 1, 0, 0.5])
panel = Panel("C:\Users\perezmartinezIgn\Desktop\D\15_Doc-WIP\31.07.2021_Abgabe\src")
crv = Curve(<curve referenced from the Rhino model>)
number_slider = Slider(134, range=0..1000)
python = GhPythonScript(
    src=panel,
    iCurv=crv,
    iN=Slider(6, range=0..10),
    iParams=genes_3,
    iDirections=genes,
    iSplits=genes_2,
    iAv="10000",
    iCentralSquare=Toggle(False))  # -> oPlots, o_diff, o_av_diff, oPoints, oStartPoint, oSquare; inputs iCurv: Curve, iN: Int32, iParams: list, iDirections: list, iSplits: list of Int32, iAv: Int32
# ---------- python: Python ----------
import ghpythonlib.components as ghcomp
import rhinoscriptsyntax as rs
import ghpythonlib.treehelpers as tree
import Rhino.Geometry as rg
import sys


if src not in sys.path:
    sys.path.append(src)

if 'load' in locals() and load:
    plot_subdivision = reload(plot_subdivision)
    
import plot_subdivision as ps

if iN <= 1:
    c = iCurv
    o_diff = 1
    o_av_diff = 1
else:
    plot_subdivision = ps.Plot(iCurv, iN, iParams, iDirections, iSplits)
    c = plot_subdivision.subdivide_plot()
    dif_tupple = ps.average_area_diff(c, iAv)
    o_diff = dif_tupple[0]
    o_av_diff = dif_tupple[1]
    av_area = dif_tupple[2]

centroid_plot = ghcomp.Area(iCurv)[1]
centroid_subplots = [ghcomp.Area(polycurve)[1] for polycurve in c]

if iCentralSquare == True:
    centroid_square = centroid_subplots[0]
    square = c[0]
    index = 0
    for i, (cen, polycurve) in enumerate(zip(centroid_subplots, c)):
        distance = centroid_plot.DistanceTo(cen)
        if centroid_plot.DistanceTo(cen) < centroid_plot.DistanceTo(centroid_square):
            centroid_square = cen
            square = polycurve
            index = i
    centroid_subplots.pop(index)
    c.pop(index)
    square_surface = ghcomp.BoundarySurfaces(square)

else:
    centroid_subplots = [ghcomp.Area(polycurve)[1] for polycurve in c if ghcomp.Area(polycurve)[0] > av_area * 0.35]
    square_surface = []

oPlots = c
oPoints = centroid_subplots
oStartPoint = iCurv.PointAt(0)
oSquare = square_surface
# ---------- end python ----------
rgb = ColourRGB(Alpha=255, Red=number_slider, Green=number_slider, Blue=0)
preview = CustomPreview(Geometry=python.oSquare, Material=rgb)
sortpath = CSharpScript(P=python.oStartPoint, S=python.oPoints)  # -> A; inputs P: Point3d, S: list of Point3d
# ---------- sortpath: C# ----------
    List<Point3d> ptsSorted = new List<Point3d>();
    int count = S.Count;

    for(int i = 0; i < count; i++)
    {
      Point3dList ptsToSort = new Point3dList(S);
      int closestIndex = ptsToSort.ClosestIndex(P);

      ptsSorted.Add(S[closestIndex]);
      S.RemoveAt(closestIndex);
      P = ptsToSort[closestIndex];
    }

    A = ptsSorted;
# ---------- end sortpath ----------
panel_2 = Panel(python.oPlots)
intcrv = Interpolate(Vertices=sortpath, Degree=3, Periodic=False, KnotStyle=1)  # -> Curve, Length, Domain
ghpython_script = GhPythonScript(src=panel, iPlots=python.oPlots, street_width=Slider(11, range=0..100), building_width=Slider(5, range=0..10))  # -> out, output; inputs iPlots: list
# ---------- ghpython_script: Python ----------
import sys

if src not in sys.path:
    sys.path.append(src)
    
import utility
import buildings

load = True
if 'load' in locals() and load:
    utility = reload(utility)
    buildings = reload(buildings)

from buildings import *
    
building_plots = Buildings(iPlots, street_width, building_width)
building_typ = building_plots.offset_plot()

output = building_typ

print output
# ---------- end ghpython_script ----------
panel_3 = Panel(ghpython_script.output)
